vi "HelloBlink.gviweb"   [LabVIEW NXG 5.1.0]
uses:
  PicoGLib::Core::Println.gvi
  PicoGLib::GPIO::Init.gvi
  PicoGLib::GPIO::SetOutput.gvi
  PicoGLib::GPIO::Write.gvi
diagram:
  while (iteration -> i1) {
    Format Value(format string="Hello LabWorld %d", value=i1) -> (output string=w1)
    call "Println.gvi"(String=w1)
    Wait(time to wait=1000)
    stop if FALSE
  }
  w2 = 25  # Pin
  call "Init.gvi"(Pin In=w2) -> (Pin <Pin In>=w3)
  call "SetOutput.gvi"(Pin In=w3, Output?=TRUE) -> (Pin <Pin In>=w4)
  s1 = TRUE  # shift register
  while {
    call "Write.gvi"(Pin In=w4, Value=s1)
    Wait(time to wait=500)
    Not(x=s1) -> w5
    next s1 = w5
    stop if FALSE
  }
