vi "Queue.gviweb"   [LabVIEW NXG 5.1.0]
uses:
  PicoGLib::Core::Println.gvi
  PicoGLib::GPIO::Init.gvi
  PicoGLib::GPIO::SetOutput.gvi
  PicoGLib::GPIO::Write.gvi
diagram:
  Obtain Queue(element data type=i32 0) -> (queue out=w1)
  while (iteration -> i1) {
    Enqueue Element(element=i1, queue=w1)
    Wait(time to wait=500)
    stop if FALSE
  }
  while {
    Dequeue Element(queue=w1) -> (element=w2)
    Number To Decimal String(number=w2) -> (decimal integer string=w3)
    Concatenate Strings("Queued: ", w3) -> w4
    call "Println.gvi"(String=w4)
    stop if FALSE
  }
  w5 = 25  # Pin
  call "Init.gvi"(Pin In=w5) -> (Pin <Pin In>=w6)
  call "SetOutput.gvi"(Pin In=w6, Output?=TRUE) -> (Pin <Pin In>=w7)
  s1 = TRUE  # shift register
  while {
    call "Write.gvi"(Pin In=w7, Value=s1)
    Wait(time to wait=250)
    Not(x=s1) -> w8
    next s1 = w8
    stop if FALSE
  }
