vi "Sweep.gviweb"   [LabVIEW NXG 5.1.0]
uses:
  PicoGLib::GPIO::Init.gvi
  PicoGLib::GPIO::SetOutput.gvi
  PicoGLib::GPIO::Write.gvi
  PicoGLib::Core::MemUsed.gvi
  PicoGLib::Core::Println.gvi
diagram:
  for {
    w1 = each element of [16, 15, 17, 14, 18, 13, 19, 12, 20, 11]
    call "Init.gvi"(Pin In=w1) -> (Pin <Pin In>=w3)
    call "SetOutput.gvi"(Pin In=w3, Output?=TRUE) -> (Pin <Pin In>=w4)
    append w4 to w2
  }
  Array Size(array=w2) -> (size(s)=w5)
  s1 = 0  # shift register
  while {
    for (iteration -> i1) {
      w6 = each element of w2
      Is Equal(x=s1, y=i1) -> w7
      call "Write.gvi"(Pin In=w6, Value=w7)
    }
    Increment(x=s1) -> w8
    Quotient And Remainder(x=w8, y=w5) -> (x-y*floor(x/y)=w9)
    Wait(time to wait=100)
    next s1 = w9
    stop if FALSE
  }
  call "MemUsed.gvi"() -> (MemUsed=w10)
  Format Value(format string="Mem: %d", value=w10) -> (output string=w11)
  call "Println.gvi"(String=w11)
