vi "HelloBlink.gviweb"   [G Web Development Software 21.0.0]
uses:
  picoG::Stdio::Println.gvi
  picoG::GPIO::LED Pin.gvi
  picoG::GPIO::Init.gvi
  picoG::GPIO::SetOutput.gvi
  picoG::GPIO::Write.gvi
diagram:
  while (iteration -> i1) {
    Format Value(format string="Hello LabWORLD %d", value=i1) -> (output string=w1)
    call "Println.gvi"(String=w1)
    Wait(time to wait=1000)
    stop if FALSE
  }
  call "LED Pin.gvi"() -> (LED Pin=w2)
  call "Init.gvi"(Pin in=w2) -> (Pin <Pin in>=w3)
  call "SetOutput.gvi"(Pin in=w3, Is Output?=TRUE) -> (Pin <Pin in>=w4)
  s1 = TRUE  # shift register
  while {
    Not(x=s1) -> w5
    Wait(time to wait=500)
    call "Write.gvi"(Pin in=w4, Value=s1)
    next s1 = w5
    stop if FALSE
  }
