vi "BlinkCount.gviweb"   [G Web Development Software 21.0.0]
uses:
  picoG::GPIO::Init.gvi
  picoG::GPIO::SetOutput.gvi
  picoG::GPIO::Write.gvi
diagram:
  call "Init.gvi"(Pin in=25) -> (Pin <Pin in>=w1)
  call "SetOutput.gvi"(Pin in=w1, Is Output?=TRUE) -> (Pin <Pin in>=w2)
  Multiply(2, 2) -> w3
  s1 = TRUE  # shift register
  for (N = w3) {
    Not(x=s1) -> w4
    call "Write.gvi"(Pin in=w2, Value=s1)
    Wait(time to wait=400)
    next s1 = w4
  }
