vi "HelloWorld.gviweb"   [G Web Development Software 21.0.0]
uses:
  picoG::Stdio::Println.gvi
  picoG::GPIO::Init.gvi
  picoG::GPIO::SetOutput.gvi
  picoG::GPIO::Write.gvi
diagram:
  while (iteration -> i1) {
    Wait(time to wait=2000)
    Format Value(format string="Hello LabWORLD %d!", value=i1) -> (output string=w1)
    call "Println.gvi"(String=w1)
    stop if FALSE
  }
  w2 = 25  # Pin
  call "Init.gvi"(Pin in=w2) -> (Pin <Pin in>=w3)
  call "SetOutput.gvi"(Pin in=w3, Is Output?=TRUE) -> (Pin <Pin in>=w4)
  s1 = TRUE  # shift register
  while {
    Not(x=s1) -> w5
    call "Write.gvi"(Pin in=w4, Value=s1)
    Wait(time to wait=250)
    next s1 = w5
    stop if FALSE
  }
