vi "StdinBinaryDisplay.gviweb"   [G Web Development Software 21.0.0]
uses:
  picoG::GPIO::Init.gvi
  picoG::GPIO::SetOutput.gvi
  picoG::GPIO::Write.gvi
  picoG::Stdio::Print.gvi
  picoG::Stdio::StreamRead.gvi
diagram:
  for {
    w1 = each element of [16, 15, 17, 14, 18, 13, 19, 12, 20, 11]
    call "Init.gvi"(Pin in=w1) -> (Pin <Pin in>=w3)
    call "SetOutput.gvi"(Pin in=w3, Is Output?=TRUE) -> (Pin <Pin in>=w4)
    call "Write.gvi"(Pin in=w4, Value=FALSE) -> (Pin <Pin in>=w5)
    append w5 to w2
  }
  s1 = 0  # shift register
  s2 = uninitialised  # shift register
  while {
    case (s1) {
      frame 2 {
        Decimal String To Number(string=s2) -> (number=w8)
        In Range And Coerce(lower limit=0, upper limit=1023, x=w8) -> (coerced(x)=w9)
        Number To Boolean Array(number=w9) -> (Boolean array=w10)
        for {
          w11 = each element of w2
          w12 = each element of w10
          call "Write.gvi"(Pin in=w11, Value=w12)
        }
        w6 = 0
        w7 = s2
      }
      frame 0, Default {
        call "Print.gvi"(String="\nEnter a number 0-1023 and press enter: ")
        w6 = 1
        w7 = ""
      }
      frame 1 {
        call "StreamRead.gvi"(FileHandle="StdIn"(0), Count=1) -> (String=w13)
        Is Equal(x=w13, y="\n") -> w14
        Is Equal(x="\r", y=w13) -> w15
        Logical Or(w14, w15) -> w16
        Select(s=w16, t=2, f=1) -> w6
        case (w16) {
          frame False, Default {
            Concatenate Strings(s2, w13) -> w7
          }
          frame True {
            w7 = s2
          }
        }
        call "Print.gvi"(String=w13)
      }
    }
    next s1 = w6
    next s2 = w7
    stop if FALSE
  }
