vi "TestStreamRead.gviweb"   [G Web Development Software 21.0.0]
uses:
  picoG::Stdio::Println.gvi
  picoG::Stdio::Print.gvi
  picoG::Stdio::StreamRead.gvi
diagram:
  s1 = 0  # shift register
  s2 = uninitialised  # shift register
  while {
    case (s1) {
      frame 2 {
        Concatenate Strings("Salutations, ", s2, "!") -> w3
        call "Println.gvi"(String=w3)
        w1 = 0
        w2 = s2
      }
      frame 0, Default {
        call "Print.gvi"(String="\nEnter your name and press enter: ")
        w1 = 1
        w2 = ""
      }
      frame 1 {
        call "StreamRead.gvi"(FileHandle="StdIn"(0), Count=1) -> (String=w4)
        Is Equal(x=w4, y="\n") -> w5
        Is Equal(x="\r", y=w4) -> w6
        Logical Or(w5, w6) -> w7
        Select(s=w7, t=2, f=1) -> w1
        case (w7) {
          frame False, Default {
            Concatenate Strings(s2, w4) -> w2
          }
          frame True {
            w2 = s2
          }
        }
        call "Print.gvi"(String=w4)
      }
    }
    next s1 = w1
    next s2 = w2
    stop if FALSE
  }
